% Simulink data dictionary SharedData.sldd

batteryVoltageMin = Simulink.Parameter(20)
batteryCurrentMax = Simulink.Parameter(120)
speedCommandMin = Simulink.Parameter(0)
speedCommandMax = Simulink.Parameter(100)
pwmWriteMin = Simulink.Parameter(0)
pwmWriteMax = Simulink.Parameter(255)
estopMotorSpeed = Simulink.Parameter(0)
motorRPMMax = Simulink.Parameter(32000)
stepsBeforeEstop = Simulink.Parameter(4)
batteryVoltReductionFactor = Simulink.Parameter(11)
analogReadMin = Simulink.Parameter(0)
analogReadMax = Simulink.Parameter(1023)
arduinoVolts = Simulink.Parameter(5)
batteryCurrentSensorSensitivity = Simulink.Parameter(0.02)
batteryVoltageMax = Simulink.Parameter(26)
controllerKd = Simulink.Parameter(0.1)
controllerKp = Simulink.Parameter(0.25)
controllerKi = Simulink.Parameter(0.1)
controllerFilterCoeff = Simulink.Parameter(1)
PWMFrequency = Simulink.Parameter(490.2, Unit="Hz")
escPulseLengthMax = Simulink.Parameter(2022)
escPulseLengthMin = Simulink.Parameter(1500)
Run_on_Hardware_Configuration = Simulink.ConfigSet(StartTime="0", StopTime="inf", Solver="ode3", ProdHWDeviceType="Atmel->AVR", SystemTargetFile="ert.tlc", HardwareBoard="Arduino Uno", TargetLang="C")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